# Dynamo graph script.dyn (Dynamo 2.6.1.8786)
# packages: Clockwork for Dynamo 2.x 2.3.0, Data-Shapes 2022.2.105, Clockwork for Dynamo 2.x 2.6.0, Genius Loci 2023.2.21

# group: Base-LVL (OKFF EG)
levels = Levels("00_EG_OKFB_VS")

# group: Select View
views = Views("Raw Room Height")

rooms_by_status = RoomsByStatus()
watch = Watch(rooms_by_status.PlacedRooms)
level = Custom[Element.Level](element=watch)  # package Clockwork for Dynamo 2.x; Gets an element's level
name = Element.Name(element=level)
code_block = CodeBlock { "OKFB"; }
contains = String.Contains(str=name, searchFor=code_block)
filterByBoolMask = List.FilterByBoolMask(list=watch, mask=contains)
level_2 = Custom[Element.Level](element=filterByBoolMask.in)
code_block_2 = CodeBlock { "Elevation"; }
getParameterValueByName = Element.GetParameterValueByName(element=level_2, parameterName=code_block_2)

# group: UI
code_block_3 = CodeBlock { "What is the project base level?"; }
file_path = Filename("..\..\ShareFolder\icon.png")
code_block_4 = CodeBlock { "Next"; "Cancel"; }
code_block_5 = CodeBlock { "Levels"; }
byName = Category.ByName(name=code_block_5)
all_elements_of_category = ElementsOfCategory(Category=byName)
code_block_6 = CodeBlock { "FYI!"; }
code_block_7 = CodeBlock { "OK"; "Cancel"; }
code_block_8 = CodeBlock()
# ---------- code_block_8.designscript (10 lines) ----------
"For the following application you will need some things:\n
1. 3D View with the name: Raw Room Height\n
        - A view just with rooms and finished geometry\n
2. Room Parameter:\n
        - CXS Lichte_Raumhoehe_max\n
        - CXS Roh_Raumhoehe_max\n
        - OKFB\n
        - OKRB\n
        - UKFD\n
        - UKRD\n";
# ----------------------------------------
textnote_data = Custom[TextNote Data](TextNote=code_block_8)  # package Data-Shapes; Create Data for TextNote input in UI.MultipleInputForm ++ . Check out www.data-shapes.net for more informations
boolean = BoolSelector(true)
code_block_9 = CodeBlock { "https://github.com/CrossArchitecture"; }
code_block_10 = CodeBlock { 600; }
multipleinputform = Custom[MultipleInputForm ++](Description_optional=code_block_6, Logo_optional=file_path, ButtonText_optional=code_block_7.out0, Inputs=textnote_data, Toggle=boolean, LinkToHelp_optional=code_block_9, CancelButtonText_optional=code_block_7.out1, Width_optional=code_block_10)  # package Data-Shapes; Create a form with multiple inputs. see www.data-shapes.net for tutorials and infos!

name_2 = Element.Name(element=all_elements_of_category)

# group (continued): UI
listview_data = Custom[Listview Data](Keys=name_2, Values=all_elements_of_category)  # package Data-Shapes; Create data for ListView input in UI.MultiInputForm ++ . Check out www.data-shapes.net for more infos.
passthrough = Custom[Passthrough](passThrough=listview_data, waitFor=multipleinputform.Was_Run)  # package Clockwork for Dynamo 2.x; Forces a sequential order of execution. The node wired into the output of the Passthrough node will be executed *after* the node wired into the waitFor input (e.g. important for some Revit operations). The value of the passThrough input will be passed on to the node wired into the output port of the Passthrough node.
multipleinputform_2 = Custom[MultipleInputForm ++](Description_optional=code_block_3, Logo_optional=file_path, ButtonText_optional=code_block_4.out0, Inputs=passthrough, Toggle=boolean, LinkToHelp_optional=code_block_9, CancelButtonText_optional=code_block_4.out1, Width_optional=code_block_10)

flatten = List.Flatten(list=multipleinputform_2.User_Inputs)
getParameterValueByName_2 = Element.GetParameterValueByName(element=flatten, parameterName=code_block_2)
sub = getParameterValueByName - getParameterValueByName_2  # lacing=Longest
watch_2 = Watch(sub)
location = Room.Location(room=filterByBoolMask.in)
code_block_11 = CodeBlock { "CXS Lichte_Raumhoehe_max"; }
getParameterValueByName_3 = Element.GetParameterValueByName(element=filterByBoolMask.in, parameterName=code_block_11)
code_block_12 = CodeBlock { 1; 0; }
mul = getParameterValueByName_3 * code_block_12.out0
replaceNull = Custom[List.ReplaceNull](seq=mul, replacement=code_block_12.out1)  # package Clockwork for Dynamo 2.x; Replaces all null values within a given list with a substitute
add = sub + replaceNull

# group: UKFD
code_block_13 = CodeBlock { "UKFD"; }
setParameterByName = Element.SetParameterByName(element=filterByBoolMask.in, parameterName=code_block_13, value=add)

# group: OKFB
code_block_14 = CodeBlock { "OKFB"; }
setParameterByName_2 = Element.SetParameterByName(element=filterByBoolMask.in, parameterName=code_block_14, value=sub)

list_create = List.Create(item0=setParameterByName, item1=setParameterByName_2)
end = Revit.Transaction.Transaction.End(input=list_create)
start = Revit.Transaction.Transaction.Start(input=end)
passthrough_2 = Custom[Passthrough](passThrough=location, waitFor=start)
ZAxis = Vector.ZAxis()
code_block_15 = CodeBlock { 0.1; }
translate = Geometry.Translate(geometry=passthrough_2, direction=ZAxis, distance=code_block_15)
reverse = Vector.Reverse(vector=ZAxis)
code_block_16 = CodeBlock { 1; }
code_block_17 = CodeBlock { "Raw Room Height"; True; }  # unwired: True
view_byname = Custom[View ByName](ViewName=code_block_17.out0, DoesContain=code_block_17.True)  # package Genius Loci; Collect views by given name in the active or given document. Based on a Christian Gartland's script.
byOriginDirection = Revit.References.RayBounce.ByOriginDirection(origin=translate, direction=reverse, maxBounces=code_block_16, view=view_byname)
firstItem = List.FirstItem(list=byOriginDirection.points@L2)
lastItem = List.LastItem(list=byOriginDirection.points@L2)
byTwoPoints = Vector.ByTwoPoints(start=firstItem, end=lastItem)
length = Vector.Length(vector=byTwoPoints)
sub_2 = length - code_block_15
sub_3 = watch_2 - sub_2
code_block_18 = CodeBlock { "CXS Roh_Raumhoehe_max"; }
getParameterValueByName_4 = Element.GetParameterValueByName(element=filterByBoolMask.in, parameterName=code_block_18)
add_2 = sub_3 + getParameterValueByName_4

# group: UKRD
code_block_19 = CodeBlock { "UKRD"; }
setParameterByName_3 = Element.SetParameterByName(element=filterByBoolMask.in, parameterName=code_block_19, value=add_2)

# group: OKRB
code_block_20 = CodeBlock { "OKRB"; }
setParameterByName_4 = Element.SetParameterByName(element=filterByBoolMask.in, parameterName=code_block_20, value=sub_3)
